# Grasshopper definition Palmanova Talha Eren Yaprak.gh (Grasshopper 1.0.7)
# plug-ins: Bowerbird2

colour_swatch = ColourSwatch(SwatchColor=RGB(190, 130, 113))
colour_swatch_2 = ColourSwatch(SwatchColor=RGB(193, 145, 119))
colour_swatch_3 = ColourSwatch(SwatchColor=RGB(210, 174, 156))
colour_swatch_4 = ColourSwatch(SwatchColor=RGB(171, 111, 94))
colour_swatch_5 = ColourSwatch(SwatchColor=RGB(222, 192, 181))
colour_swatch_6 = ColourSwatch(SwatchColor=RGB(1, 37, 75))
colour_swatch_7 = ColourSwatch(SwatchColor=RGB(4, 103, 174))
colour_swatch_8 = ColourSwatch(SwatchColor=RGB(9, 123, 202))
colour_swatch_9 = ColourSwatch(SwatchColor=RGB(30, 157, 241))
colour_swatch_10 = ColourSwatch(SwatchColor=RGB(207, 239, 254))
number_slider = Slider(20, range=0..100)
polygon_corner = Slider(9, range=0..15)
series = Series(Start=0, Step=1, Count="10")
panel = Panel("Inner wall edge")
# Calculate rotation angle based on arc length of polygon
division = Division(A="360", B=polygon_corner)
center_polygon_corner = Slider(6, range=0..10)
multiplication = Multiplication(A=number_slider, B=Slider(4, range=0..10))
multiplication_2 = Multiplication(A=number_slider, B=Slider(2, range=0..10))
multiplication_3 = Multiplication(A=number_slider, B=Slider(3, range=0..10))
multiplication_4 = Multiplication(A=series, B=division)
panel_2 = Panel("Produce Polygons")
polygon = Polygon(Plane=PlaneXY(0, 0, 0), Radius=number_slider, Segments=center_polygon_corner, FilletRadius=0)  # -> Polygon, Length
polygon_2 = Polygon(Plane=PlaneXY(0, 0, 0), Radius=multiplication_2, Segments=polygon_corner, FilletRadius=0)  # -> Polygon, Length
polygon_3 = Polygon(Plane=PlaneXY(0, 0, 0), Radius=multiplication_3, Segments=polygon_corner, FilletRadius=0)  # -> Polygon, Length
polygon_4 = Polygon(Plane=PlaneXY(0, 0, 0), Radius=multiplication, Segments=polygon_corner, FilletRadius=0)  # -> Polygon, Length
smaller_than = SmallerThan(FirstNumber=multiplication_4, SecondNumber="90")  # -> flatten(SmallerThan), OrEqualTo
panel_3 = Panel("Generating the bastions")
# drawing vectors to reference our roads to
explode = Explode(Curve=polygon.Polygon, Recursive=True)  # -> Segments, Vertices
integer = Integer(flatten(smaller_than.SmallerThan))
panel_4 = Panel("Orient polygons")
flank_length = Slider(36, range=0..100)
mass_addition = MassAddition(Input=[integer, "-1"])  # -> Result, PartialResults
list_item = ListItem(List=multiplication_4, Index=mass_addition.Result, Wrap=True)
subtraction = Subtraction(A="90", B=list_item)
radians = Radians(Degrees=subtraction)
rotate = Rotate(Geometry=polygon_4.Polygon, Angle=radians, Plane=PlaneXY(0, 0, 0))  # -> Geometry, Transform
offset_curve = OffsetCurve(Curve=rotate.Geometry, Distance=Slider(5, range=0..10), Corners=1)
rotate_2 = Rotate(Geometry=polygon_2.Polygon, Angle=radians, Plane=PlaneXY(0, 0, 0))  # -> Geometry, Transform
rotate_3 = Rotate(Geometry=polygon_3.Polygon, Angle=radians, Plane=PlaneXY(0, 0, 0))  # -> Geometry, Transform
# our exploded polygon has n+1 vertice so we cull dup
point_on_curve = PointOnCurve(explode.Segments, parameter=0.5)
flank_placement = Slider(0.7, range=0.5..1)
offset_curve_2 = OffsetCurve(Curve=rotate.Geometry, Distance=Slider(10, range=0..50), Corners=1)
evaluate_curve = EvaluateCurve(Curve=explode.Segments, Parameter=point_on_curve)  # -> Point, Tangent, Angle
construct_domain = ConstructDomain(DomainStart=0, DomainEnd=flank_length)
construct_domain_2 = ConstructDomain(DomainStart=Slider(1, range=0..1), DomainEnd=Slider(0, range=0..100))
explode_2 = Explode(Curve=offset_curve_2, Recursive=True)  # -> Segments, Vertices
point_on_curve_2 = PointOnCurve(explode_2.Segments, parameter=0.5)
bastion_flank_length_factor = Slider(2, range=0..100)
rotate_4 = Rotate(Geometry=evaluate_curve.Tangent, Angle=-1.570796327, Plane=PlaneXY(0, 0, 0))  # -> Geometry, Transform
panel_5 = Panel("Bastion Flank")
rotate_5 = Rotate(Geometry=explode_2.Segments, Angle=1.570796327, Plane=point_on_curve_2)  # -> Geometry, Transform
cull_duplicates = CullDuplicates(Points=explode_2.Vertices, Tolerance=0.1, CullMode=3)  # -> Points, Indices, Valence
evaluate_curve_2 = EvaluateCurve(Curve=reparameterize(explode_2.Segments), Parameter=flank_placement)  # -> Point, Tangent, Angle
bastion_point_length = Slider(42, range=0..100)
line_sdl = LineSDL(Start=point_on_curve, Direction=rotate_4.Geometry, Length=Slider(100, range=0..100))
vector = Vector(rotate_5.Geometry)
multiplication_5 = Multiplication(A=flank_placement, B=bastion_flank_length_factor)
explode_3 = Explode(Curve=rotate.Geometry, Recursive=True)  # -> Segments, simplify(flatten(Vertices))
panel_6 = Panel("Bastion Point")
boundary_surfaces = BoundarySurfaces(Edges=rotate.Geometry)
line = Line(StartPoint=cull_duplicates.Points, EndPoint=Point(0, 0, 0))
# Produce inner paths and trim to the outer length
trim_with_region = TrimWithRegion(Curve=line_sdl, Region=rotate.Geometry)  # -> flatten(Inside), Outside
cull_duplicates_2 = CullDuplicates(Points=evaluate_curve_2.Point, Tolerance=0.1, CullMode=3)  # -> Points, Indices, Valence
curve_curve = CurveCurve(CurveA=rotate.Geometry, CurveB=trim_with_region.Outside)  # -> flatten(Points), ParamsA, ParamsB
remap_numbers = RemapNumbers(Value=multiplication_5, Source=construct_domain_2, Target=construct_domain)  # -> Mapped, Clipped
colour_swatch_11 = ColourSwatch(SwatchColor=RGB(207, 239, 254))
negative = Negative(Value=bastion_point_length)
line_sdl_2 = LineSDL(Start=cull_duplicates_2.Points, Direction=vector, Length=remap_numbers.Mapped)
panel_7 = Panel("Roads")
cull_duplicates_3 = CullDuplicates(Points=[explode_3.Vertices, curve_curve.Points], Tolerance=0.1, CullMode=2)  # -> Points, Indices, Valence
line_sdl_3 = LineSDL(Start=cull_duplicates.Points, Direction=line, Length=negative)
surface_split = SurfaceSplit(
    Surface=boundary_surfaces,
    Curves=flatten([trim_with_region.Inside, polygon.Polygon, rotate_2.Geometry, rotate_3.Geometry, rotate.Geometry]))
panel_8 = Panel("Right Flank")
# Generate districts of city
area = Area(Geometry=surface_split)  # -> Area, Centroid
end_points = EndPoints(Curve=line_sdl_2)  # -> Start, End
# Calculate intersections only at edges and not vertice for doors
list_item_2 = ListItem(List=explode_3.Vertices, Index=cull_duplicates_3.Indices, Wrap=False)
edges_from_faces = EdgesFromFaces(Brep=surface_split, Points=area.Centroid)  # -> Edges, Indices
end_points_2 = EndPoints(Curve=line_sdl_3)  # -> Start, End
cull_duplicates_4 = CullDuplicates(Points=[cull_duplicates_3.Points, list_item_2], Tolerance=0.1, CullMode=2)  # -> Points, Indices, Valence
join_curves = JoinCurves(Curves=edges_from_faces.Edges, Preserve=False)  # -> flatten(Curves)
point = Point(Point(0, 0, 0))
# Bastion Shape vertices in order
rotate_3d = Rotate3D(Geometry=line_sdl_2, Angle=degrees(Slider(180, range=0..1000)), Center=end_points_2.End, Axis=line_sdl_3)  # -> Geometry, Transform
# Turn districts into 3d buildings, excluding town square
number_slider_2 = Slider(-2, range=-10..10)
addition = Addition(A=end_points_2.Start, B=end_points.Start)
vector_2pt = Vector2Pt(PointA=point, PointB=cull_duplicates_4.Points, Unitize=False)  # -> Vector, Length

line_sdl_4 = LineSDL(Start=cull_duplicates_4.Points, Direction=vector_2pt.Vector, Length=vector_2pt.Length)
panel_9 = Panel("Bridge")
bb_offset = BBOffset(Curves=line_sdl_4, Distance=Slider(2, range=0..10), EndType=1, JoinType=1, MiterLimit=10, ArcTolerance=0.01)  # -> flatten(Curve)
explode_4 = Explode(Curve=bb_offset, Recursive=True)  # -> Segments, flatten(Vertices)
number_slider_3 = Slider(4, range=0..10)
cull_duplicates_5 = CullDuplicates(Points=explode_4.Vertices, Tolerance=0.1, CullMode=1)  # -> Points, Indices, Valence
cull_pattern = CullPattern(List=cull_duplicates_5.Points, CullPattern=[True, False, False, False])
cull_pattern_2 = CullPattern(List=cull_duplicates_5.Points, CullPattern=[False, True, False, False])
cull_pattern_3 = CullPattern(List=cull_duplicates_5.Points, CullPattern=[False, False, True, False])
cull_pattern_4 = CullPattern(List=cull_duplicates_5.Points, CullPattern=[False, False, False, True])
_4point_surface = _4PointSurface(CornerA=cull_pattern, CornerB=cull_pattern_2, CornerC=cull_pattern_3, CornerD=cull_pattern_4)

colour_swatch_12 = ColourSwatch(SwatchColor=RGB(214, 208, 180))
custom_preview = CustomPreview(Geometry=[boundary_surfaces, _4point_surface], Material=ColourSwatch(SwatchColor=RGB(157, 150, 135)))

cull_index = CullIndex(List=join_curves, Indices=0, Wrap=True)
number_slider_4 = Slider(3, range=0..10)
line_sdl_5 = LineSDL(Start=cull_duplicates_4.Points, Direction=vector_2pt.Vector, Length=Slider(10, range=0..10))
division_2 = Division(A=addition, B=2)
panel_10 = Panel("Deadzone coverage")
panel_11 = Panel("Left Flank")
end_points_3 = EndPoints(Curve=rotate_3d.Geometry)  # -> Start, End
addition_2 = Addition(A=end_points_2.Start, B=end_points_3.Start)
division_3 = Division(A=addition_2, B=2)
offset_curve_3 = OffsetCurve(Curve=cull_index, Distance=Slider(-6, range=-10..10), Corners=1)  # -> simplify(Curve)
offset_curve_4 = OffsetCurve(Curve=cull_index, Distance=number_slider_2, Corners=1)  # -> simplify(Curve)
negative_2 = Negative(Value=number_slider_4)
# Midpoints of wall faces
addition_3 = Addition(A=end_points_2.End, B=end_points_3.End)
addition_4 = Addition(A=end_points_2.End, B=end_points.End)
vector_display = VectorDisplay(Anchor=cull_duplicates_4.Points, Vector=vector_2pt.Vector)
curve_closest_point = CurveClosestPoint(Point=division_3, Curve=offset_curve)  # -> Point, Parameter, Distance
curve_closest_point_2 = CurveClosestPoint(Point=division_2, Curve=offset_curve)  # -> Point, Parameter, Distance
merge = Merge(Data1=offset_curve_3, Data2=offset_curve_4)
division_4 = Division(A=addition_3, B=2)
division_5 = Division(A=addition_4, B=2)
offset_curve_5 = OffsetCurve(Curve=line_sdl_5, Distance=negative_2, Corners=1)
# Draw aligned rectangles. Probably not the best way but it isn't inefficient.
offset_curve_6 = OffsetCurve(Curve=line_sdl_5, Distance=number_slider_4, Corners=1)
boundary_surfaces_2 = BoundarySurfaces(Edges=merge)
unit_z = UnitZ(Factor=Slider(5, range=0..10))
weave = Weave(Pattern=[0, 1, 2], Stream0=end_points.End, Stream1=end_points_2.End, Stream2=end_points_3.End, NullGaps=False)
end_points_4 = EndPoints(Curve=offset_curve_5)  # -> Start, End
end_points_5 = EndPoints(Curve=offset_curve_6)  # -> Start, End
colour_swatch_13 = ColourSwatch(SwatchColor=RGB(1, 37, 75))
extrude = Extrude(Base=boundary_surfaces_2, Direction=unit_z)

colour_swatch_14 = ColourSwatch(SwatchColor=RGB(161, 50, 50))
custom_preview_2 = CustomPreview(Geometry=extrude, Material=ColourSwatch(SwatchColor=RGB(94, 52, 24)))

polyline = PolyLine(Vertices=weave, Closed=True)
number_slider_5 = Slider(7, range=0..10)
rectangle_3pt = Rectangle3Pt(PointA=end_points_5.Start, PointB=end_points_5.End, PointC=end_points_4.Start)  # -> Rectangle, Length
panel_12 = Panel("Drawing Outer Wall")
weave_2 = Weave(
    Pattern=[0, 1, 2, 3, 4, 5, 6, 7, 8, 9, 10],
    Stream0=curve_closest_point_2.Point,
    Stream1=division_2,
    Stream2=end_points.Start,
    Stream3=end_points.End,
    Stream4=division_5,
    Stream5=end_points_2.End,
    Stream6=division_4,
    Stream7=end_points_3.End,
    Stream8=end_points_3.Start,
    Stream9=division_3,
    Stream10=curve_closest_point.Point,
    NullGaps=False)
number_slider_6 = Slider(1.57, range=0.5..4)
# Moat and Moat wall, taking reference from the same elements to save computation
number_slider_7 = Slider(4, range=0..10)
offset_curve_7 = OffsetCurve(Curve=polyline, Distance=Slider(20, range=0..100), Corners=Slider(3, range=0..10))  # -> flatten(Curve)
box_rectangle = BoxRectangle(Rectangle=rectangle_3pt.Rectangle, Height=number_slider_5)  # -> flatten(Box)
nurbs_curve = NurbsCurve(Vertices=weave_2, Degree=2, Periodic=True)  # -> flatten(Curve), Length, Domain
unit_z_2 = UnitZ(Factor=number_slider_5)
scale_nu = ScaleNU(
    Geometry=box_rectangle,
    Plane=flatten(rectangle_3pt.Rectangle),
    ScaleX=1,
    ScaleY=Slider(0.6, range=0..1),
    ScaleZ=Slider(0.9, range=0..1))  # -> Geometry, Transform
negative_3 = Negative(Value=number_slider_6)
unit_z_3 = UnitZ(Factor=1)  # -> reverse(UnitVector)
offset_curve_8 = OffsetCurve(Curve=offset_curve_7, Distance=number_slider_7, Corners=1)  # -> flatten(Curve)
offset_curve_9 = OffsetCurve(Curve=nurbs_curve.Curve, Distance=number_slider_6, Corners=1)  # -> flatten(Curve)
point_2 = Point(Point(0, 0, -0.1))
boundary_surfaces_3 = BoundarySurfaces(Edges=flatten([offset_curve_7, nurbs_curve.Curve]))
move = Move(Geometry=nurbs_curve.Curve, Motion=unit_z_2)  # -> flatten(Geometry), Transform
offset_curve_10 = OffsetCurve(Curve=nurbs_curve.Curve, Distance=negative_3, Corners=1)  # -> flatten(Curve)
panel_13 = Panel("Slope portion")
boundary_surfaces_4 = BoundarySurfaces(Edges=flatten([rotate.Geometry, offset_curve_10]))
move_2 = Move(Geometry=boundary_surfaces_3, Motion=point_2)  # -> Geometry, Transform
boundary_surfaces_5 = BoundarySurfaces(Edges=[offset_curve_8, offset_curve_7])
subtraction_2 = Subtraction(A=unit_z_2, B=unit_z_3)
solid_difference = SolidDifference(BrepsA=box_rectangle, BrepsB=scale_nu.Geometry)
merge_2 = Merge(Data1=offset_curve_10, Data2=nurbs_curve.Curve)
panel_14 = Panel("Draw Porta")
loft = Loft(
    Curves=[offset_curve_9, move.Geometry],
    Options={Adjust=False, Closed=False, LoftEnds=0, LoftSimp=2, LoftType=3, Rebuild=10, Refit=0.01})
panel_15 = Panel("Walkway")
extrude_2 = Extrude(Base=boundary_surfaces_4, Direction=subtraction_2)
colour_swatch_15 = ColourSwatch(SwatchColor=RGB(30, 157, 241))

colour_swatch_16 = ColourSwatch(SwatchColor=RGB(71, 123, 161))
custom_preview_3 = CustomPreview(Geometry=move_2.Geometry, Material=ColourSwatch(SwatchColor=RGB(123, 109, 83)))

colour_swatch_17 = ColourSwatch(SwatchColor=RGB(207, 239, 254))

colour_swatch_18 = ColourSwatch(SwatchColor=RGB(214, 208, 180))
custom_preview_4 = CustomPreview(Geometry=boundary_surfaces_5, Material=ColourSwatch(SwatchColor=RGB(157, 150, 135)))

boundary_surfaces_6 = BoundarySurfaces(Edges=merge_2)
extrude_3 = Extrude(Base=boundary_surfaces_6, Direction=unit_z_2)

colour_swatch_19 = ColourSwatch(SwatchColor=RGB(166, 148, 13))
custom_preview_5 = CustomPreview(Geometry=solid_difference, Material=ColourSwatch(SwatchColor=RGB(170, 125, 100)))

colour_swatch_20 = ColourSwatch(SwatchColor=RGB(4, 103, 174))
solid_difference_2 = SolidDifference(BrepsA=extrude_2, BrepsB=box_rectangle)
solid_difference_3 = SolidDifference(BrepsA=extrude_3, BrepsB=box_rectangle)
colour_swatch_21 = ColourSwatch(SwatchColor=RGB(4, 103, 174))

colour_swatch_22 = ColourSwatch(SwatchColor=RGB(166, 148, 13))
custom_preview_6 = CustomPreview(Geometry=solid_difference_2, Material=ColourSwatch(SwatchColor=RGB(170, 125, 100)))

colour_swatch_23 = ColourSwatch(SwatchColor=RGB(9, 123, 202))

colour_swatch_24 = ColourSwatch(SwatchColor=RGB(122, 109, 10))
custom_preview_7 = CustomPreview(Geometry=solid_difference_3, Material=ColourSwatch(SwatchColor=RGB(140, 87, 61)))
